# Grasshopper definition UAV-CBEM-sharing.gh (Grasshopper 1.0.7)
# plug-ins: FalseStartToggle, CORE.Toolbox.Grasshopper, ClimateStudioGH, Urbano, LunchBox

# ---- group: New construction set / Workflow to create new construction units from materials
opaquemat = HBOpaqueMaterial(name="Brick", thickness="0.25", conductivity="0.82", density="1760", spec_heat="800", sol_absp="0.65")  # -> mat; plug-in component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
# New construction set
panel = Panel(opaquemat)
opaqueconstr = HBOpaqueConstruction(name="Indian Brick wall baseline", materials=opaquemat)  # -> constr; plug-in component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
panel_2 = Panel(opaqueconstr)
decnstrconstr = HBDeconstructConstruction(constr=opaqueconstr)  # -> materials, layers, r_val_si, r_val_ip, u_fac_si, u_fac_ip, shgc, t_sol, t_vis; plug-in component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
panel_3 = Panel(decnstrconstr.u_fac_si)

# ----
# SEMI-AUTOMATIC CBEM DECISION SUPPORT SYSTEM FOR NET-ZERO PLANNING
ladybug = Ladybug_Ladybug()  # -> Vviiiiiiiiiizzz; plug-in component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

# ---- group: New construction set / Workflow to create new construction units from materials
opaquemat_2 = HBOpaqueMaterial(name="Concrete roof", thickness="0.20", conductivity="0.264", density="2288", spec_heat="880", sol_absp="0.65")  # -> mat; plug-in component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
panel_4 = Panel(opaquemat_2)
opaqueconstr_2 = HBOpaqueConstruction(name="Indian RCC roof baseline", materials=opaquemat_2)  # -> constr; plug-in component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
panel_5 = Panel(opaqueconstr_2)
decnstrconstr_2 = HBDeconstructConstruction(constr=opaqueconstr_2)  # -> materials, layers, r_val_si, r_val_ip, u_fac_si, u_fac_ip, shgc, t_sol, t_vis; plug-in component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
panel_6 = Panel(decnstrconstr_2.u_fac_si)

# ---- group: New construction set / Construct new window construction
windowmat = HBWindowMaterial(name="Single pane glass", u_factor="5.8", shgc="0.8")  # -> mat; plug-in component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
windowconstr = HBWindowConstruction(name="Indian single pane baseline", materials=windowmat)  # -> constr; plug-in component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
decnstrconstr_3 = HBDeconstructConstruction(constr=windowconstr)  # -> materials, layers, r_val_si, r_val_ip, u_fac_si, u_fac_ip, shgc, t_sol, t_vis; plug-in component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
panel_7 = Panel(windowconstr)
# Energy efficient construction set
panel_8 = Panel(decnstrconstr_3.shgc)
panel_9 = Panel(decnstrconstr_3.u_fac_si)
subfacesubset = HBSubfaceSubset(window=windowconstr)  # -> subface_set; plug-in component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

# ----
# UAV
path = FilePath("C:\Users\HP\Desktop\IITB\Learning\Grasshopper-UBEM\Inputs\UAV\Building_footprint\Building_footprint_excel.xlsx")
# OSM
path_2 = FilePath("C:\Users\HP\Downloads\EUI_shapefile_1.xlsx")

# ---- group: New construction set
# Workflow to create new construction units from materials: in this case, external walls with bricks
# Workflow to create new construction units from materials: in this case, roof
# Workflow to construct new window construction
exteriorsubset = HBExteriorConstructionSubset(exterior_wall=opaqueconstr, exterior_roof=opaqueconstr_2)  # -> exterior_set; plug-in component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
constructionset = HBConstructionSet(exterior_subset=exteriorsubset, subface_subset=subfacesubset)  # -> constr_set; plug-in component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

# ----
# OSM
panel_10 = Panel("4")
# UAV
panel_11 = Panel("1")
# OSM
path_3 = FilePath("C:\Users\HP\Downloads\EUI_shapefile_1.shp")
# UAV
path_4 = FilePath("C:\Users\HP\Desktop\IITB\Learning\Grasshopper-UBEM\Inputs\UAV\Building_footprint\Building_footprint.shp")

# ----
# To create building footprints from shapefile
toggle = BooleanToggle(True)
xl_in = ReadFromExcel(WorkbookFilepath=path, Live=toggle, Stream=toggle)
panel_12 = Panel(xl_in)
data = Data(xl_in)
flip = FlipMatrix(Data=data)
branch = TreeBranch(Tree=flip, Path=panel_11, MaintainPaths=True)
importshp = ImportShapefileFeatures(ShapefilePath=path_4, Reproject=True)  # -> Points, Metadata, UTMZone, TranslationVector
split = SplitList(List=branch, Index="1")  # -> ListA, ListB
Z = UnitZ(Factor=split.ListB)
pline = PolyLine(Vertices=importshp.Points, Closed=False)
graft = GraftTree(Tree=pline, IncludeEmptyLists=True, IncludeNullItems=True)
toggle_2 = FalseStartToggle(False)
clean = CleanTree(RemoveNulls=True, RemoveInvalid=True, RemoveEmpty=toggle_2, Tree=graft)
boundary = BoundarySurfaces(Edges=clean)  # -> flatten(Surfaces)
extr = Extrude(Base=boundary, Direction=Z)
preview = CustomPreview(Geometry=extr, Material=ColourSwatch(SwatchColor=RGB(148, 91, 30)))

# ----
# To create surfaces of tree shapefile
toggle_3 = BooleanToggle(True)
path_5 = FilePath("C:\Users\HP\Desktop\IITB\Learning\Grasshopper-UBEM\Inputs\Trees\tree_height.xlsx")
xl_in_2 = ReadFromExcel(WorkbookFilepath=path_5, Live=toggle_3, Stream=toggle_3)
panel_13 = Panel(xl_in_2)
data_2 = Data(xl_in_2)
flip_2 = FlipMatrix(Data=data_2)
path_6 = FilePath("C:\Users\HP\Desktop\IITB\Learning\Grasshopper-UBEM\Inputs\Trees\tree_height.shp")
branch_2 = TreeBranch(Tree=flip_2, Path="1", MaintainPaths=True)
importshp_2 = ImportShapefileFeatures(ShapefilePath=path_6, Reproject=True, UTMZone="42N", TranslationVector=importshp.TranslationVector)  # -> Points, Metadata, UTMZone, TranslationVector
split_2 = SplitList(List=branch_2, Index="1")  # -> ListA, ListB
Z_2 = UnitZ(Factor=split_2.ListB)
pline_2 = PolyLine(Vertices=importshp_2.Points, Closed=False)
graft_2 = GraftTree(Tree=pline_2, IncludeEmptyLists=True, IncludeNullItems=True)
toggle_4 = FalseStartToggle(False)
clean_2 = CleanTree(RemoveNulls=True, RemoveInvalid=True, RemoveEmpty=toggle_4, Tree=graft_2)
boundary_2 = BoundarySurfaces(Edges=clean_2)  # -> flatten(Surfaces)
move = Move(Geometry=boundary_2, Motion=Z_2)  # -> Geometry, Transform
preview_2 = CustomPreview(Geometry=move.Geometry, Material=ColourSwatch(SwatchColor=RGB(0, 104, 0)))

# ----
# Tree bark viz
area = Area(Geometry=move.Geometry)  # -> Area, Centroid
pt = Point(area.Centroid)
multiplication = Multiplication(A=split_2.ListB, B="-1")
cyl = Cylinder(Base=pt, Radius="1", Length=multiplication)
preview_3 = CustomPreview(Geometry=cyl, Material=ColourSwatch(SwatchColor=RGB(133, 62, 32)))

# ----
# AHRAE 90.1 2013 | IECC 2015
panel_14 = Panel("ApartmentMidRise OCC_APT_SCH")

# ----
# Occupancy load factor - 26.5 W/m2
# considered based on Indian ref
# (Shukla et al, 2015) ->
# 1/26.5-> 0.037
panel_15 = Panel("0.037")

# ----
# Custom ProgramType
# Ventilation is set to 0;
# Heating and cooling setpoints
#  are changed subsequently
panel_16 = Panel("2013::MidriseApartment::Apartment")
deconstrprogram = HBDeconstructProgramType(program=panel_16)  # -> people, lighting, electric_equip, gas_equip, hot_water, infiltration, ventilation, setpoint; plug-in component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
setpoint = HBSetpoint(
    name="University Setpoint",
    heating_sch="SchoolSecondary HTGSETP_SCH_YES_OPTIMUM",
    cooling_sch="SchoolSecondary CLGSETP_SCH_NO_SETBACK")  # -> setpoint; plug-in component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
ventilation = HBVentilation(name="University Ventilation", flow_per_person="0")  # -> vent; plug-in component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
people = HBPeople(name="Indian residential apartment", ppl_per_area=panel_15, occupancy_sch=panel_14)  # -> people; plug-in component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
programtype = HBProgramType(
    name="Indian residential apartment",
    people=people,
    lighting=deconstrprogram.lighting,
    electric_equip=deconstrprogram.electric_equip,
    infiltration=deconstrprogram.infiltration,
    ventilation=ventilation,
    setpoint=setpoint)  # -> program; plug-in component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

# ----
# Custom setpoint schedules
# (night time air-conditioned)
# Heating setpoint schedule
# Cooling setpoint schedule
cooling_hourly_schedule = Panel("""24
24
24
24
24
24
24
60
60
60
60
60
60
60
60
60
60
60
60
60
60
60
24
24""")
heating_hourly_schedule = Panel("""0
0
0
0
0
0
0
0
0
0
0
0
0
0
0
0
0
0
0
0
0
0
0
0""")
dup = DuplicateData(Data=cooling_hourly_schedule, Number="365", Order=True)
dup_2 = DuplicateData(Data=heating_hourly_schedule, Number="365", Order=True)
data_3 = Data(dup)
panel_17 = Panel(data_3)
data_4 = Data(dup_2)
panel_18 = Panel(data_4)
fixedintervalschedule = HBFixedIntervalSchedule(values=panel_17, type_limit="Temperature")  # -> report, schedule; plug-in component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
fixedintervalschedule_2 = HBFixedIntervalSchedule(values=data_4, type_limit="Temperature")  # -> report, schedule; plug-in component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

# ----
# Radius
panel_19 = Panel("30")

# ----
# Number of floors
panel_20 = Panel()

toggle_5 = FalseStartToggle(False)
window_op_sch = Panel("1")
path_7 = FilePath("C:\Users\HP\Desktop\IITB\Learning\Grasshopper-UBEM\Inputs\windowop_schedule_updated_updated.xlsx")
colorrooms = HBColorRooms()  # -> report, mesh, wire_frame, legend, title, rooms, colors, values, vis_set; plug-in component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
dup_3 = DuplicateData(Data=window_op_sch, Number="8760", Order=True)
data_5 = Data(dup_3)
panel_21 = Panel(data_5)
panel_22 = Panel("""34.70
32.05
28.17
26.48
74.78
29.22
24.77
27.75
31.86
24.55
13.57
23.74
16.27
14.86""")
# A UAV-Enhanced Community Building Energy Modeling Framework
colorrooms_2 = HBColorRooms()  # -> report, mesh, wire_frame, legend, title, rooms, colors, values, vis_set; plug-in component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
item = ListItem(List=panel_22, Index=Slider(0, range=0..13), Wrap=True)
colrange = LBColorRange(index=item)  # -> colors; plug-in component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
pt_2 = Point(Point(-112.9527452, 410.5309631, 0))
genes = GenePool(Decimals=1, Maximum=1, Minimum=0, Value=[0.7, 0.5, 1, 1, 0.5, 0.8, 0.7, 0.8, 1, 1, 0.4, 0.6, 0.5, 0.3])
panel_23 = Panel(genes)
rec = DataRecorder(DataLimit=-10, RecordData=True)
panel_24 = Panel(rec)
rec_2 = DataRecorder(DataLimit=-10, RecordData=True)
panel_25 = Panel(rec_2)
number_slider = Slider(13, range=0..13)

# ----
# Lighting hourly load
panel_26 = Panel("8760")
partition = PartitionList(List=panel_25, Size=panel_26)  # -> simplify(Chunks)
# Equipment hourly load
viewer = ParamViewer(partition)
branch_3 = TreeBranch(Tree=partition, Path=number_slider, MaintainPaths=True)
panel_27 = Panel(branch_3)

partition_2 = PartitionList(List=panel_24, Size="8760")  # -> simplify(Chunks)
viewer_2 = ParamViewer(partition_2)
branch_4 = TreeBranch(Tree=partition_2, Path=number_slider, MaintainPaths=True)
panel_28 = Panel(branch_4)

# ---- group: Collecting WWR from Excel
# Cooling space fraction for buildings
toggle_6 = BooleanToggle(True)
path_8 = FilePath("C:\Users\HP\Desktop\IITB\Learning\Grasshopper-UBEM\Inputs\CoolingSpaceFraction.xlsx")
xl_in_3 = ReadFromExcel(WorkbookFilepath=path_8, Live=False, Stream=toggle_6)
data_6 = Data(xl_in_3)
flip_3 = FlipMatrix(Data=data_6)
branch_5 = TreeBranch(Tree=flip_3, Path="1", MaintainPaths=True)
split_3 = SplitList(List=branch_5, Index="1")  # -> ListA, ListB
panel_29 = Panel(split_3.ListB)

# ----
# Buildings order
branch_6 = TreeBranch(Tree=flip_3, Path="0", MaintainPaths=True)
split_4 = SplitList(List=branch_6, Index="1")  # -> ListA, ListB
panel_30 = Panel(split_4.ListB)

# ---- group: Collecting WWR from Excel
# Window Wall Ratio (Order-North, East, South, West)
path_9 = FilePath("C:\Users\HP\Desktop\IITB\Learning\Grasshopper-UBEM\Inputs\WWR.xlsx")
xl_in_4 = ReadFromExcel(WorkbookFilepath=path_9, Live=False, Stream=Toggle(True))
data_7 = Data(xl_in_4)
flip_4 = FlipMatrix(Data=data_7)
branch_7 = TreeBranch(Tree=flip_4, Path="0", MaintainPaths=True)
split_5 = SplitList(List=branch_7, Index="1")  # -> ListA, ListB
panel_31 = Panel(split_5.ListB)
partition_3 = PartitionList(List=panel_31, Size="4")
flip_5 = FlipMatrix(Data=partition_3)

# ----
# Looping the buildings workflow within a specific radius
number_slider_2 = Slider(0, range=0..13)
cull_i = CullIndex(List=extr, Indices=number_slider_2, Wrap=True)
item_2 = ListItem(List=extr, Index=number_slider_2, Wrap=True)
preview_4 = CustomPreview(Geometry=item_2, Material=ColourSwatch(SwatchColor=RGB(145, 84, 161)))
preview_5 = CustomPreview(Geometry=cull_i, Material=ColourSwatch(SwatchColor=RGB(84, 161, 129)))
roomsolid = HBRoomFromSolid(geo=flatten(item_2), constr_set=constructionset, program=programtype, conditioned=Toggle(True))  # -> report, rooms; plug-in component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

# ---- group: Collecting WWR from Excel (continued)
item_3 = ListItem(List=split_3.ListB, Index=number_slider_2, Wrap=True)
panel_32 = Panel(item_3)

item_4 = ListItem(List=flip_5, Index=number_slider_2, Wrap=True)
panel_33 = Panel(item_4)
flip_6 = FlipMatrix(Data=panel_33)
# Click for Automation!
panel_34 = Panel(flip_6)

# ---- group: Filtering the buildings within a specific radiis
area_2 = Area(Geometry=item_2)  # -> Area, Centroid
pt_3 = Point(area_2.Centroid)
sph = Sphere(Base=pt_3, Radius=panel_19)
shapein = ShapeInBrep(Brep=sph, Shape=cull_i)
larger = LargerThan(FirstNumber=shapein, SecondNumber="1")  # -> LargerThan, OrEqualTo
panel_35 = Panel(larger.LargerThan)
mindex = MemberIndex(Set=panel_35, Member="False")  # -> Index, Count

# ----
panel_36 = Panel(shapein)

# ---- group: Tree shading within a specific radius
shapein_2 = ShapeInBrep(Brep=sph, Shape=move.Geometry)
larger_2 = LargerThan(FirstNumber=shapein_2, SecondNumber="1")  # -> LargerThan, OrEqualTo
panel_37 = Panel(larger_2.LargerThan)
mindex_2 = MemberIndex(Set=panel_37, Member="False")  # -> Index, Count
item_5 = ListItem(List=move.Geometry, Index=mindex_2.Index, Wrap=True)
shade = HBShade(geo=item_5)  # -> report, shades; plug-in component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

# ---- group: Automating slider control
toggle_7 = FalseStartToggle(False)
fly = Ladybug_fly(inputSliders=number_slider_2, fly=toggle_7)  # -> Vviiiiiiiiiizzz; inputs inputSliders: list, fly: Boolean; plug-in component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

# ----
item_6 = ListItem(List=cull_i, Index=mindex.Index, Wrap=True)

shade_2 = HBShade(geo=item_6)  # -> report, shades; plug-in component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

# ----
# Assign Schedues
applyroomsch = HBApplyRoomSchedules(
    room_or_program=flatten(roomsolid.rooms),
    heating_setpt_sch=fixedintervalschedule_2.schedule,
    cooling_setpt_sch=fixedintervalschedule.schedule)  # -> report, mod_obj; plug-in component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

preview_6 = CustomPreview(Geometry=item_6, Material=ColourSwatch(SwatchColor=RGB(158, 236, 255)))

# ----
# Window Wall Ratio (Order-North, East, South, West)
aperturesbyratio = HBAperturesByRatio(hb_objs=flatten(applyroomsch.mod_obj), ratio=flip_6, subdivide=Toggle(False), operable=toggle_5)  # -> report, hb_objs; plug-in component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
panel_38 = Panel(aperturesbyratio.hb_objs)

# ----
# Visualize Attributes
faceenergyattr = HBFaceEnergyAttributes({"Construction": "properties.energy.construction.display_name", "Materials": "properties.energy.construction.layers", "R-Value": "properties.energy.construction.r_value", "U-Value": "properties.energy.construction.u_value", "U-Factor": "properties.energy.construction.u_factor", "Solar Transmitance [Unshaded]": "properties.energy.construction.solar_transmittance", "Solar Reflectance [Outside]": "properties.energy.construction.outside_solar_reflectance", "Solar Reflectance [Inside]": "properties.energy.construction.inside_solar_reflectance"}, selected="Construction")
colorfaceattr = HBColorFaceAttributes(hb_objs=flatten(aperturesbyratio.hb_objs), attribute=faceenergyattr)  # -> mesh, legend, wire_frame, values, colors, vis_set; plug-in component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

item_7 = ListItem(List=genes, Index=number_slider_2, Wrap=True)

# ----
# Mixed Mode Control with windows allowing natural ventilation to come in
toggle_8 = FalseStartToggle(False)
path_10 = FilePath("C:\Users\HP\Downloads\cooling.xlsx")
excelread = ExcelReader(ReadExcelData=toggle_8, WorkbookPath=path_7, WorksheetName=number_slider_2)  # -> Exceptions, ExcelData
panel_39 = Panel(excelread.ExcelData)
panel_40 = Panel("19")
panel_41 = Panel("23")
toggle_9 = FalseStartToggle(False)

cull_i_2 = CullIndex(List=excelread.ExcelData, Indices="0", Wrap=True)
panel_42 = Panel(cull_i_2)

num = Number(cull_i_2)
eval = Evaluate(F="if(x>0,1,x)", x=num)
panel_43 = Panel(eval)
fixedintervalschedule_3 = HBFixedIntervalSchedule(values=eval, name="VentCooling_Sch")  # -> report, schedule; plug-in component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
ventcontrol = HBVentilationControl(min_out_temp="12", delta_temp="0.5", schedule=fixedintervalschedule_3.schedule)  # -> vent_cntrl; plug-in component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
windowopen = HBWindowOpening(rooms=flatten(aperturesbyratio.hb_objs), vent_cntrl=ventcontrol, fract_area_oper="0.5", wind_cross_vent=toggle_9)  # -> report, rooms; plug-in component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

# ----
# Energy simulation
panel_44 = Panel("UBEM")
# Run Energy Simulation!
panel_45 = Panel("1")
pt_4 = Point(Point(60.78816345, 27.94460282, 0))
panel_46 = Panel("C:\Users\HP\Desktop\IITB\Learning\Grasshopper\Weather file\IND_MH_Mumbai-Shivaji.Intl.AP.430030_TMYx.2007-2021\IND_MH_Mumbai-Shivaji.Intl.AP.430030_TMYx.2007-2021.epw")
model = HBModel(rooms=flatten(windowopen.rooms), shades=flatten([shade_2.shades, shade.shades]), name=panel_44)  # -> report, model; plug-in component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
compass = LBCompass(north="0", center=pt_4, scale=panel_45)  # -> compass; plug-in component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
toggle_10 = FalseStartToggle(False)

# ----
# Energy simulation parameters for
# including comfort outputs
toggle_11 = BooleanToggle(True)
simoutput = HBSimulationOutput(zone_energy_use=toggle_11, hvac_energy_use=toggle_11, comfort_metrics=toggle_11, surface_temperature=toggle_11)  # -> report, sim_output; plug-in component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
simpar = HBSimulationParameter(north="0", output=simoutput.sim_output, timestep=6)  # -> sim_par; plug-in component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

modeltoosm = HBModelToOSM(model=model.model, epw_file=panel_46, sim_par=simpar, write=toggle_10, run=toggle_10)  # -> report, jsons, osw, osm, idf, sql, zsz, rdd, html; plug-in component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

# ---- group: Energyoutput
roomenergyresult = HBReadRoomEnergyResult(sql=modeltoosm.sql)  # -> cooling, heating, lighting, electric_equip, gas_equip, process, hot_water, fan_electric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; plug-in component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
panel_47 = Panel(roomenergyresult.cooling)
pt_5 = Point(Point(-104.5785795, 162.1215775, 0))
hourlyplot = LBHourlyPlot(data=roomenergyresult.cooling, base_pt=pt_5)  # -> report, mesh, legend, borders, labels, title, vis_set; plug-in component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

# ---- group: Reading Operative temperature inside room
roomcomfortresult = HBReadRoomComfortResult(sql=modeltoosm.sql)  # -> oper_temp, air_temp, rad_temp, rel_humidity; plug-in component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
xdata = LBDeconstructData(data=roomcomfortresult.oper_temp)  # -> header, values; plug-in component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
panel_48 = Panel(xdata.values)

# ---- group: Reading epw file
importepw = LBImportEPW(epw_file=panel_46)  # -> location, dry_bulb_temperature, dew_point_temperature, relative_humidity, wind_speed, wind_direction, direct_normal_rad, diffuse_horizontal_rad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; plug-in component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
xdata_2 = LBDeconstructData(data=importepw.dry_bulb_temperature)  # -> header, values; plug-in component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
panel_49 = Panel(xdata_2.values)

# ----
panel_50 = Panel(roomenergyresult.lighting)
xdata_3 = LBDeconstructData(data=roomenergyresult.lighting)  # -> header, values; plug-in component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
xdata_4 = LBDeconstructData(data=roomcomfortresult.air_temp)  # -> header, values; plug-in component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
xdata_5 = LBDeconstructData(data=roomenergyresult.electric_equip)  # -> header, values; plug-in component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
xdata_6 = LBDeconstructData(data=importepw.diffuse_horizontal_rad)  # -> header, values; plug-in component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
panel_51 = Panel(xdata_6.values)
panel_52 = Panel(xdata_3.values)
panel_53 = Panel(xdata_4.values)
hourlyplot_2 = LBHourlyPlot(data=roomcomfortresult.oper_temp, base_pt=pt_2)  # -> report, mesh, legend, borders, labels, title, vis_set; plug-in component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
xdata_7 = LBDeconstructData(data=roomenergyresult.cooling)  # -> header, values; plug-in component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
panel_54 = Panel(xdata_7.values)
rec_3 = DataRecorder(panel_54, DataLimit=-10, RecordData=True)
# Cooling Space
# Fraction
multiplication_2 = Multiplication(A=xdata_7.values, B=item_3)
panel_55 = Panel(rec_3)
# Number of floors
multiplication_3 = Multiplication(A=xdata_3.values, B=panel_20)

# ----
# Writing the Lighting load and storing them in an  excel sheet.
# First, turn this value to true
# Second, turn the run toogle to true.
# Last, fly slider to true
panel_56 = Panel("C:\Users\HP\Desktop\IITB\Learning\Grasshopper-UBEM\Inputs\")
concat = Concatenate(FragmentA=panel_56, FragmentB="lighting_load_compile", FragmentD=".xlsx")
entwine = Entwine(Branch00="Lighting load", FlattenInputs=True)  # -> flatten(Result)
panel_57 = Panel(concat)
panel_58 = Panel(entwine)
toggle_12 = FalseStartToggle(False)
excelwrite = ExcelWrite(
    WriteExcelData=toggle_12,
    WorkbookPath=concat,
    WorksheetName=number_slider_2,
    ColumnHeadings=panel_58,
    Data=multiplication_3,
    ClearSheet=False)
panel_59 = Panel(excelwrite)

panel_60 = Panel(multiplication_3)
# Number of floors
multiplication_4 = Multiplication(A=xdata_5.values, B=panel_20)

# ----
# Writing the equipment load and storing them in an  excel sheet.
# First, turn this value to true
# Second, turn the run toogle to true.
# Last, fly slider to true
panel_61 = Panel("C:\Users\HP\Desktop\IITB\Learning\Grasshopper-UBEM\Inputs\")
concat_2 = Concatenate(FragmentA=panel_61, FragmentB="equipment_load_compile", FragmentD=".xlsx")
entwine_2 = Entwine(Branch00="Equipment load", FlattenInputs=True)  # -> flatten(Result)
panel_62 = Panel(concat_2)
panel_63 = Panel(entwine_2)
toggle_13 = FalseStartToggle(False)
excelwrite_2 = ExcelWrite(
    WriteExcelData=toggle_13,
    WorkbookPath=concat_2,
    WorksheetName=number_slider_2,
    ColumnHeadings=panel_63,
    Data=multiplication_4,
    ClearSheet=False)
panel_64 = Panel(excelwrite_2)

# ----
# Equipt loading % -> to bring ASHRAE standards to Indian equipment schedules
# (This is an assumption)
multiplication_5 = Multiplication(A=multiplication_4, B=item_7)
panel_65 = Panel(multiplication_5)

# ---- group: EUI
# Cooling energy consumption can be taken directly as EUI * footprint area
# However, for lighting and equipment,
# the EUI should be divided by the gross footprint area coming from this shoeboxmodel multiplied
# by actual floor area taking into account number of floors.
# This is taken care by multiplying with number of floors
toggle_14 = FalseStartToggle(False)
eui = HBEndUseIntensity(sql=modeltoosm.sql, ip=toggle_14)  # -> eui, eui_end_use, end_uses, gross_floor; plug-in component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
panel_66 = Panel(eui.gross_floor)
panel_67 = Panel(eui.eui)
panel_68 = Panel(eui.end_uses)
panel_69 = Panel(eui.eui_end_use)
# Cooling spacing fraction multiplier
iseer_of_ac_split_ac_5_star = Panel("3.5")
item_8 = ListItem(List=eui.eui_end_use, Index=Slider(0, range=0..2), Wrap=True)
multiplication_6 = Multiplication(A=item_8, B=panel_66)
multiplication_7 = Multiplication(A=multiplication_6)
item_9 = ListItem(List=eui.eui_end_use, Index=Slider(1, range=0..2), Wrap=True)
item_10 = ListItem(List=eui.eui_end_use, Index=Slider(2, range=0..2), Wrap=True)
annual_cooling_load_kwh = Panel(multiplication_6)
division = Division(A=multiplication_7, B=iseer_of_ac_split_ac_5_star)
multiplication_8 = Multiplication(A=item_9, B=panel_66)
multiplication_9 = Multiplication(A=item_10, B=panel_66)
annual_shoebox_lighting_consumption_kwh = Panel(multiplication_8)
annual_cooling_energy_consumption_includ = Panel(division)  # "Annual Cooling energy consumption including cooling space fraction (kWh)"
annual_shoebox_eqpt_consumption_kwh = Panel(multiplication_9)

# ----
division_2 = Division(A=multiplication_6, B=iseer_of_ac_split_ac_5_star)

multiplication_10 = Multiplication(A=multiplication_8, B=panel_20)
actual_lighting_consumption_kwh = Panel(multiplication_10)
# Equipt loading % -> to bring ASHRAE standards to Indian equipment schedules
# (This is an assumption)
multiplication_11 = Multiplication(A=multiplication_9, B=panel_20)
actual_eqpt_consumption_kwh = Panel(multiplication_11)
multiplication_12 = Multiplication(A=multiplication_11, B=item_7)

# ---- group: EUI (continued)
annual_cooling_energy_consumption_exclud = Panel(division_2)  # "Annual Cooling energy consumption excluding cooling space fraction (kWh)"
compiled_electricity_consumption_kwh_0_c = Panel([annual_cooling_energy_consumption_includ, multiplication_10, multiplication_12])  # "Compiled Electricity consumption (kWh) 0. Cooling 1. Lighting 2. Equipmt"

# ----
# ISEER = 3.5
division_3 = Division(A=multiplication_2, B=iseer_of_ac_split_ac_5_star)

# ----
# Writing the cooling load and storing them in an  excel sheet.
# First, turn this value to true
# Second, turn the run toogle to true.
# Last, fly slider to true
panel_70 = Panel("C:\Users\HP\Desktop\IITB\Learning\Grasshopper-UBEM\Inputs\")
panel_71 = Panel("windowop_schedule")
concat_3 = Concatenate(FragmentA=panel_70, FragmentB="cooling_load_compile", FragmentD=".xlsx")
entwine_3 = Entwine(Branch00="Cooling load", FlattenInputs=True)  # -> flatten(Result)
panel_72 = Panel(concat_3)
panel_73 = Panel(entwine_3)
toggle_15 = FalseStartToggle(False)
excelwrite_3 = ExcelWrite(
    WriteExcelData=toggle_15,
    WorkbookPath=concat_3,
    WorksheetName=number_slider_2,
    ColumnHeadings=panel_73,
    Data=division_3,
    ClearSheet=False)
panel_74 = Panel(excelwrite_3)

rec_4 = DataRecorder(compiled_electricity_consumption_kwh_0_c, DataLimit=-10, RecordData=True)

addition = Addition(A=annual_cooling_energy_consumption_includ, B=multiplication_10, C=multiplication_12)

# ----
# To be copied to excel ->
panel_75 = Panel(rec_4)

division_4 = Division(A=addition, B="1000")
rec_5 = DataRecorder(division_4, DataLimit=-10, RecordData=True)
panel_76 = Panel(rec_5)

# ----
# Recording the data
rec_6 = DataRecorder(division, DataLimit=-10, RecordData=True)
panel_77 = Panel(rec_6)

# ----
# Recording the data
rec_7 = DataRecorder(division_2, DataLimit=-10, RecordData=True)
panel_78 = Panel(rec_7)

# ---- group: Plotting
path_11 = FilePath("C:\Users\HP\Downloads\")
plotter = CSPlotter(
    Type=Slider(0, range=0..3),
    Width=550,
    Height=450,
    X_title="Buildings",
    Y_title="Cooling energy consumption(kWh)",
    X_labels=panel_30,
    X_rot=0,
    Y_data=panel_78,
    Grid_x="1",
    Show_xgrid=False,
    Show_ygrid=Toggle(False),
    Legend="3",
    Bar_width="25",
    PDF_path=path_11,
    PreviewDimension=Slider(2, range=0..2),
    InfinateZoomDisplay=True,
    UnitSystem=4)
